# Grasshopper definition definition.gh (Grasshopper 1.0.7)

keyswitch_hole_padding = Panel("3")
ratio = Slider(0.6, range=0.1..0.9)
columns = Slider(5, range=3..6)
rows = Slider(4, range=3..6)
keyswitch_hole_dim = Panel("14.4")
expression = Expression(x=keyswitch_hole_padding, Expression="x*2")
columns_2 = Slider(7, range=6..8)
addition = Addition(A=keyswitch_hole_dim, B=expression)
multiplication = Multiplication(A=addition, B=rows)
multiplication_2 = Multiplication(A=multiplication, B=ratio)
sqgrid = Square(Plane=PlaneXY(0, 0, 0), Size=addition, ExtentX=columns, ExtentY=rows)  # -> Cells, Points
vec = VectorXYZ(XComponent=0, YComponent=0, ZComponent=Slider(4.71, range=0..20))  # -> Vector, Length
vec_2 = VectorXYZ(XComponent=0, YComponent=multiplication_2, ZComponent=Slider(0, range=0..20))  # -> Vector, Length
vec_3 = VectorXYZ(XComponent=0, YComponent=multiplication, ZComponent=Slider(13.795, range=0..20))  # -> Vector, Length
series = Series(Start=0, Step=1, Count=columns_2)
expression_2 = Expression(x=keyswitch_hole_dim, Expression="x/2")
pt = Point(simplify(sqgrid.Points))
X = UnitX(Factor=1)
pt_2 = Point([vec_3.Vector, vec_2.Vector, vec.Vector])
nurbs = NurbsCurve(Vertices=pt_2, Degree=3, Periodic=False)  # -> Curve, Length, Domain
divide = DivideCurve(Curve=nurbs.Curve, Count=rows, Kinks=False)  # -> Points, Tangents, Parameters
rows_2 = Slider(5, range=4..6)
eval = EvaluateCurve(Curve=nurbs.Curve, Parameter=divide.Parameters)  # -> Point, Tangent, Angle
rev = Reverse(Vector=eval.Tangent)
rev_2 = ReverseList(List=rev)
series_2 = Series(Start=0, Step=1, Count=rows_2)
addition_2 = Addition(A=pt, B=X)
addition_3 = Addition(A=pt, B=rev_2)
pl_3pt = Plane3Pt(PointA=pt, PointB=addition_2, PointC=addition_3)
rectangle = Rectangle(Plane=pl_3pt, XSize=keyswitch_hole_dim, YSize=keyswitch_hole_dim, Radius=0)  # -> Rectangle, Length
devec = DeconstructVector(Vector=divide.Points)  # -> XComponent, YComponent, ZComponent
panel = Panel(pt)
panel_2 = Panel(devec.ZComponent)
srf = Surface([<surface referenced from the Rhino model> x34])
clean = CleanTree(RemoveNulls=True, RemoveInvalid=True, RemoveEmpty=False, Tree=srf)
Z = UnitZ(Factor=1)
mounting_surface_offset = Panel("10")
mounting_surface_thickness = Panel("3")
join = BrepJoin(Breps=srf)  # -> Breps, Closed
Z_2 = UnitZ(Factor=1)

# ---- group: Basic Column Curve
max_columns = Panel("8")
expression_3 = Expression(x=max_columns, Expression="x-1")
division = Division(A=1, B=expression_3)
series_3 = Series(Start=0, Step=division, Count=max_columns)
basiccurvelength = Slider(150, range=125..175)
graph = GraphMapper(
    series_3,
    x0=0,
    x1=1,
    y0=0,
    y1=1,
    container_name="Bezier",
    cpx=[0, 0.4432801604, 0.6381682158, 1],
    cpy=[0.4465093017, 0.251761198, 0.5521735549, 0.534782052])
panel_3 = Panel("-25")
multiplication_3 = Multiplication(A=series_3, B=basiccurvelength)
_3rd_order_bezier_source_curve = Panel("3")
pt_3 = ConstructPoint(XCoordinate=multiplication_3, YCoordinate=0, ZCoordinate=0)
yz = YZPlane(Origin=pt_3)
Y = UnitY(Factor=1)

# ----
item = ListItem(List=series_3, Index=series, Wrap=True)
graft = GraftTree(Tree=multiplication_3, IncludeEmptyLists=True, IncludeNullItems=True)  # -> simplify(Tree)

# ---- group: Basic Row Curve
max_rows = Panel("6")
expression_4 = Expression(x=max_rows, Expression="x-1")
division_2 = Division(A=1, B=expression_4)
curvestartverticaloffset = Slider(10, range=0..10)
basiccurvelength_2 = Slider(100, range=75..125)
basiccurveheight = Slider(100, range=0..100)
series_4 = Series(Start=0, Step=division_2, Count=max_rows)
graph_2 = GraphMapper(
    series_4,
    x0=0,
    x1=1,
    y0=0,
    y1=1,
    container_name="Bezier",
    cpx=[0, 0.4634692967, 0.6796810031, 1],
    cpy=[0.3220852017, 0.2468482852, 0.3519473076, 0.4764174223])
multiplication_4 = Multiplication(A=graph_2, B=basiccurveheight)
multiplication_5 = Multiplication(A=series_4, B=basiccurvelength_2)
item_2 = ListItem(List=multiplication_4, Index=0, Wrap=True)
expression_5 = Expression(x=multiplication_4, y=item_2, z=curvestartverticaloffset, Expression="x-y+z")
_3rd_order_bezier_source_curve_2 = Panel("3")
pt_4 = ConstructPoint(XCoordinate=0, YCoordinate=multiplication_5, ZCoordinate=0)
pt_5 = ConstructPoint(XCoordinate=0, YCoordinate=multiplication_5, ZCoordinate=expression_5)
xz = XZPlane(Origin=pt_4)
X_2 = UnitX(Factor=1)

# ----
item_3 = ListItem(List=series_4, Index=series_2, Wrap=True)
intcrv = Interpolate(Vertices=pt_5, Degree=_3rd_order_bezier_source_curve_2, Periodic=False, KnotStyle=1)  # -> Curve, Length, Domain
graft_2 = GraftTree(Tree=multiplication_5, IncludeEmptyLists=True, IncludeNullItems=True)  # -> simplify(Tree)
subtraction = Subtraction(A=expression_5, B=curvestartverticaloffset)

# ---- group: Basic Column Curve (continued)
multiplication_6 = Multiplication(A=graph, B=basiccurveheight)
item_4 = ListItem(List=multiplication_6, Index=0, Wrap=True)
expression_6 = Expression(x=multiplication_6, y=item_4, z=curvestartverticaloffset, Expression="x-y+z")
pt_6 = ConstructPoint(XCoordinate=multiplication_3, YCoordinate=0, ZCoordinate=expression_6)

# ----
intcrv_2 = Interpolate(Vertices=pt_6, Degree=_3rd_order_bezier_source_curve, Periodic=False, KnotStyle=1)  # -> Curve, Length, Domain
subtraction_2 = Subtraction(A=expression_6, B=curvestartverticaloffset)
addition_4 = Addition(A=expression_6, B=simplify(graft(subtraction)))
addition_5 = Addition(A=expression_5, B=simplify(graft(subtraction_2)))
pt_7 = ConstructPoint(XCoordinate=multiplication_3, YCoordinate=graft_2, ZCoordinate=addition_4)  # -> simplify(Point)
pt_8 = ConstructPoint(XCoordinate=graft, YCoordinate=multiplication_5, ZCoordinate=addition_5)  # -> simplify(Point)
intcrv_3 = Interpolate(Vertices=pt_8, Degree=_3rd_order_bezier_source_curve_2, Periodic=False, KnotStyle=1)  # -> Curve, Length, Domain
intcrv_4 = Interpolate(Vertices=pt_7, Degree=_3rd_order_bezier_source_curve, Periodic=False, KnotStyle=1)  # -> Curve, Length, Domain
netsurf = NetworkSurface(CurvesU=flatten(intcrv_3.Curve), CurvesV=flatten(intcrv_4.Curve), Continuity=2)
pt_9 = Point(pt_8)
offset = OffsetSurface(Surface=netsurf, Distance=mounting_surface_offset, Retrim=True)
offset_2 = OffsetSurface(Surface=offset, Distance=mounting_surface_thickness, Retrim=True)
loft = Loft(
    Curves=[offset, offset_2],
    Options={Adjust=False, Closed=False, LoftEnds=0, LoftSimp=0, LoftType=0, Rebuild=10, Refit=0.01})
bvol = BoundaryVolume(Boundaries=[offset, offset_2, loft])

# ---- group: Basic Column Curve (continued)
pcx = CurvePlane(Curve=intcrv_2.Curve, Plane=yz)  # -> Points, flatten(ParamsC), ParamsP
eval_2 = EvaluateCurve(Curve=intcrv_2.Curve, Parameter=pcx.ParamsC)  # -> Point, Tangent, Angle

# ---- group: Basic Column Curve / Clean up x-value
devec_2 = DeconstructVector(Vector=eval_2.Tangent)  # -> XComponent, YComponent, ZComponent
vec_4 = VectorXYZ(XComponent=1, YComponent=devec_2.YComponent, ZComponent=devec_2.ZComponent)  # -> Vector, Length

# ---- group: Basic Column Curve (continued)
amp = Amplitude(Vector=vec_4.Vector, Amplitude=1)
pl = ConstructPlane(Origin=eval_2.Point, XAxis=amp, YAxis=Y)

# ----
vec_5 = Vector(pl)
devec_3 = DeconstructVector(Vector=vec_5)  # -> XComponent, YComponent, ZComponent

# ---- group: Basic Row Curve (continued)
pcx_2 = CurvePlane(Curve=intcrv.Curve, Plane=xz)  # -> Points, flatten(ParamsC), ParamsP
eval_3 = EvaluateCurve(Curve=intcrv.Curve, Parameter=pcx_2.ParamsC)  # -> Point, Tangent, Angle

# ---- group: Basic Row Curve / Clean up y-value
devec_4 = DeconstructVector(Vector=eval_3.Tangent)  # -> XComponent, YComponent, ZComponent
vec_6 = VectorXYZ(XComponent=devec_4.XComponent, YComponent=1, ZComponent=devec_4.ZComponent)  # -> Vector, Length

# ---- group: Basic Row Curve (continued)
amp_2 = Amplitude(Vector=vec_6.Vector, Amplitude=1)
pl_2 = ConstructPlane(Origin=eval_3.Point, XAxis=X_2, YAxis=amp_2)

# ----
vec_7 = Vector(pl_2)
devec_5 = DeconstructVector(Vector=vec_7)  # -> XComponent, YComponent, ZComponent
expression_7 = Expression(x=devec_5.ZComponent, y=devec_3.ZComponent, Expression="(x+y)/2")
vec_8 = VectorXYZ(XComponent=simplify(graft(devec_3.XComponent)), YComponent=devec_5.YComponent, ZComponent=expression_7)  # -> Vector, Length
rotate = RotateDirection(Geometry=join.Breps, Center=Point(0, 0, 0), From=Z, To=vec_8.Vector)  # -> Geometry, Transform
move = Move(Geometry=rotate.Geometry, Motion=pt_9)  # -> Geometry, Transform
panel_4 = Panel(rotate.Geometry)
